# Grasshopper definition Building_front_1.gh (Grasshopper 1.0.7)
# plug-ins: Bifocals

gene_pool = GenePool(
    Decimals=0,
    Maximum=1,
    Minimum=0,
    Value=[1, 1, 0, 0, 0, 1, 0.7747656041, 1, 1, 1, 0, 1, 0, 1, 1, 0, 0, 1, 0, 1, 1, 1, 0, 0, 1, 1, 1, 0, 0, 1])
width = Slider(10, range=0..100)
height = Slider(20, range=0..30)
number_of_panels = Slider(0.3, range=0.1..0.9)
thickens_of_panels = Slider(0.1, range=0..1)
panel_deepness = Slider(0.269, range=-0.5..0.5)
thickness_of_glass = Slider(0.15, range=0..1)
legth_of_building = Slider(30, range=0..30)
just_a_zero_for_thing_that_need_a_zero = Slider(0, range=0..30)
rectangle = Rectangle(Plane=PlaneXY(0, 0, 0), XSize=width, YSize=height, Radius=0)  # -> Rectangle, Length
divide_surface = DivideSurface(Surface=rectangle.Rectangle, UCount=width, VCount=width)  # -> flatten(Points), Normals, Parameters
height_map = Slider(4, range=0..4)
dispatch = Dispatch(List=divide_surface.Points, DispatchPattern=gene_pool)  # -> ListA, ListB
surface_from_points = SurfaceFromPoints(Points=divide_surface.Points, UCount=expr("x+1", width), Interpolate=False)
unit_y = UnitY(Factor=legth_of_building)
construct_point = ConstructPoint(XCoordinate=width, YCoordinate=panel_deepness, ZCoordinate=height)
construct_point_2 = ConstructPoint(XCoordinate=width, YCoordinate=panel_deepness, ZCoordinate=just_a_zero_for_thing_that_need_a_zero)
construct_point_3 = ConstructPoint(
    XCoordinate=just_a_zero_for_thing_that_need_a_zero,
    YCoordinate=panel_deepness,
    ZCoordinate=just_a_zero_for_thing_that_need_a_zero)
construct_point_4 = ConstructPoint(XCoordinate=just_a_zero_for_thing_that_need_a_zero, YCoordinate=panel_deepness, ZCoordinate=height)
unit_y_2 = UnitY(Factor=thickness_of_glass)
construct_domain = ConstructDomain(DomainStart=0, DomainEnd=height_map)
list_length = ListLength(List=dispatch.ListA)  # -> flatten(Length)
_4point_surface = _4PointSurface(CornerA=construct_point, CornerB=construct_point_2, CornerC=construct_point_3, CornerD=construct_point_4)
optional_seed_for_jitter_node = Slider(68, range=0..100)
range = Range(Domain=construct_domain, Steps=expr("x-1", list_length))
unit_z = UnitZ(Factor=range)
# Glass wall \/
extrude = Extrude(Base=_4point_surface, Direction=unit_y_2)
extrude_2 = Extrude(Base=_4point_surface, Direction=unit_y)

jitter = Jitter(List=unit_z, Jitter=1, Seed=optional_seed_for_jitter_node)  # -> Values, Indices

solid_difference = SolidDifference(BrepsA=extrude_2, BrepsB=extrude)
box_properties = BoxProperties(Box=extrude_2)  # -> Center, Diagonal, Area, Volume, Degeneracy
point_deform = PointDeform(Geometry=surface_from_points, Points=dispatch.ListA, Motion=jitter.Values)
construct_point_5 = ConstructPoint(XCoordinate=0, YCoordinate=panel_deepness, ZCoordinate=0)
unit_x = UnitX(Factor=1)
scale = Scale(Geometry=solid_difference, Center=box_properties.Center, Factor=Slider(1.076, range=1..2))  # -> Geometry, Transform
rotate_3d = Rotate3D(Geometry=point_deform, Angle=1.570796327, Center=Point(0, 0, 0), Axis=unit_x)  # -> Geometry, Transform
unit_y_3 = UnitY(Factor=Slider(-10, range=-10..0))
extrude_3 = Extrude(Direction=unit_y_3)
unit_x_2 = UnitX(Factor=1)
solid_difference_2 = SolidDifference()
contour = Contour(Shape=rotate_3d.Geometry, Point=Point(0, 0, 0), Direction=unit_x_2, Distance=number_of_panels)
xz_plane = XZPlane(Origin=construct_point_5)
project = Project(Geometry=contour, Plane=xz_plane)  # -> Geometry, Transform
ruled_surface = RuledSurface(CurveA=contour, CurveB=project.Geometry)
unit_x_3 = UnitX(Factor=thickens_of_panels)
# Facade \/
extrude_4 = Extrude(Base=ruled_surface, Direction=unit_x_3)
fillet_edge = FilletEdge(Shape=extrude_4, Blend=0, Metric=0)
