# Grasshopper definition Car_0.1.gh (Grasshopper 1.0.7)
# plug-ins: Pufferfish, Bifocals

car_lenght = Slider(8, range=0..10)
car_width = Slider(2, range=0..10)
wheel_size = Slider(1.19, range=0..10)
number_slider = Slider(0, range=0..10)
number_slider_2 = Slider(-1.79, range=-3..0)
number_slider_3 = Slider(1.57, range=0..3)
negative = Negative(Value=number_slider_2)
construct_point = ConstructPoint(XCoordinate=Slider(1, range=0..1), YCoordinate=0, ZCoordinate=0)
construct_point_2 = ConstructPoint(XCoordinate=car_width, YCoordinate=car_lenght, ZCoordinate=0)
construct_point_3 = ConstructPoint(XCoordinate=car_width, YCoordinate=number_slider, ZCoordinate=0)
negative_2 = Negative(Value=car_width)
vector_xyz = VectorXYZ(XComponent=0, YComponent=number_slider_2, ZComponent=number_slider_3)  # -> Vector, Length
vector_xyz_2 = VectorXYZ(XComponent=0, YComponent=negative, ZComponent=number_slider_3)  # -> Vector, Length
construct_point_4 = ConstructPoint(XCoordinate=negative_2, YCoordinate=car_lenght, ZCoordinate=0)
construct_point_5 = ConstructPoint(XCoordinate=negative_2, YCoordinate=number_slider, ZCoordinate=0)
move = Move(Geometry=[construct_point_3, construct_point_5], Motion=vector_xyz.Vector)  # -> Geometry, Transform
move_2 = Move(Geometry=[construct_point_2, construct_point_4], Motion=vector_xyz_2.Vector)  # -> Geometry, Transform
line = Line(StartPoint=construct_point_2, EndPoint=construct_point_3)
circle_cnr = CircleCNR(
    Center=[construct_point_3, construct_point_2, construct_point_4, construct_point_5],
    Normal=construct_point,
    Radius=wheel_size)
line_2 = Line(StartPoint=construct_point_4, EndPoint=construct_point_5)
number_slider_4 = Slider(0.7, range=0..10)
number_slider_5 = Slider(0.52, range=0..1)
tween_two_points = TweenTwoPoints(PointA=construct_point_4, PointB=construct_point_5, Factor=0.5)
tween_two_points_2 = TweenTwoPoints(PointA=construct_point_3, PointB=construct_point_2, Factor=0.5)
number_slider_6 = Slider(0.58, range=0..10)
negative_3 = Negative(Value=number_slider_4)
number_slider_7 = Slider(2.08, range=0..3)
negative_4 = Negative(Value=number_slider_6)
line_3 = Line(StartPoint=tween_two_points, EndPoint=tween_two_points_2)
vector_xyz_3 = VectorXYZ(XComponent=negative_3, YComponent=0, ZComponent=number_slider_5)  # -> Vector, Length
vector_xyz_4 = VectorXYZ(XComponent=number_slider_4, YComponent=0, ZComponent=number_slider_5)  # -> Vector, Length
unit_z = UnitZ(Factor=Slider(3.7, range=0..10))
vector_xyz_5 = VectorXYZ(XComponent=negative_4, YComponent=0, ZComponent=number_slider_3)  # -> Vector, Length
fit_line = FitLine(Points=move_2.Geometry)
vector_xyz_6 = VectorXYZ(XComponent=number_slider_6, YComponent=0, ZComponent=number_slider_3)  # -> Vector, Length
fit_line_2 = FitLine(Points=move.Geometry)
move_3 = Move(Geometry=line_2, Motion=vector_xyz_3.Vector)  # -> Geometry, Transform
move_4 = Move(Geometry=line, Motion=vector_xyz_4.Vector)  # -> Geometry, Transform
move_5 = Move(Geometry=line_2, Motion=vector_xyz_5.Vector)  # -> Geometry, Transform
move_6 = Move(Geometry=line, Motion=vector_xyz_6.Vector)  # -> Geometry, Transform
move_7 = Move(Geometry=line_3, Motion=unit_z)  # -> Geometry, Transform
loft = Loft(
    Curves=[fit_line_2, move_7.Geometry, fit_line],
    Options={Adjust=False, Closed=False, LoftEnds=0, LoftSimp=0, LoftType=0, Rebuild=10, Refit=0.01})
