# Grasshopper definition Firefly_test_idea.gh (Grasshopper 1.0.7)
# plug-ins: Firefly.X, Bifocals, FologramForGrasshopper

number_slider = Slider(68, range=0..100)
number_slider_2 = Slider(4, range=0..100)
sound_capture = SoundCapture(TimePeriod=Slider(0.02, range=0..0.1), StartStopSoundCapture=Toggle(True))  # -> WavePressureSamplesFromLeftChannel, WavePressureSamplesFromRightChannel, Volume
number_slider_3 = Slider(65, range=0..100)
center_box = CenterBox(Base=PlaneXY(0, 0, 0), X=number_slider, Y=number_slider, Z=number_slider)
timer = Timer(TimerInterval=20, Target=sound_capture)
populate_3d = Populate3D(Region=center_box, Count=number_slider_2, Seed=Slider(15, range=0..100))
populate_3d_2 = Populate3D(Region=center_box, Count=number_slider_2, Seed=1)
center_box_2 = CenterBox(Base=PlaneXY(0, 0, 0), X=number_slider_3, Y=number_slider_3, Z=number_slider_3)
data_recorder = DataRecorder(sound_capture.Volume, DataLimit=12, RecordData=True)
nurbs_curve = NurbsCurve(Vertices=populate_3d, Degree=3, Periodic=False)  # -> Curve, Length, Domain
nurbs_curve_2 = NurbsCurve(Vertices=populate_3d_2, Degree=3, Periodic=False)  # -> Curve, Length, Domain
multiplication = Multiplication(A=data_recorder, B=Slider(0.894, range=0.02..2))
populate_3d_3 = Populate3D(Region=center_box_2, Count=Slider(3, range=0..100), Seed=multiplication)
gene_pool = GenePool(Decimals=3, Maximum=1, Minimum=0, Value=[0, 0.113, 0.317, 0.437, 0.549, 0.62, 0.682, 0.739, 0.803, 0.851, 0.957, 1])
proximity_3d = Proximity3D(Points=populate_3d_3, Group=5)  # -> Links, Topology
pipe_variable = PipeVariable(Curve=[nurbs_curve_2.Curve, nurbs_curve.Curve], Parameters=gene_pool, Radii=multiplication, Caps=1)
sync_object = SyncObject(
    GM=proximity_3d.Links,
    AlwaysIncludeTextureCoordinates=False,
    Clickable=False,
    DefaultCurveThicknessMillimeters=2.5,
    DefaultGlossPercent=0,
    DefaultMaterialColor=RGB(0, 255, 255),
    DefaultSpecularPercent=0,
    Interactive=False,
    hasSerializedData=True)
create_material = CreateMaterial(Diffuse=RGB(240, 30, 255), Specular=RGB(255, 255, 255), Emission=RGB(0, 0, 0), Transparency=0, Shine=0)
custom_preview = CustomPreview(Geometry=pipe_variable, Material=create_material)
