# Grasshopper definition Firefly_test_idea_5.gh (Grasshopper 1.0.7)
# plug-ins: Firefly.X, Bifocals

sound_capture = SoundCapture(TimePeriod=Slider(0.02, range=0..0.1), StartStopSoundCapture=Toggle(True))  # -> WavePressureSamplesFromLeftChannel, WavePressureSamplesFromRightChannel, Volume
timer = Timer(TimerInterval=20, Target=sound_capture)
data_recorder = DataRecorder(sound_capture.Volume, DataLimit=12, RecordData=True)
multiplication = Multiplication(A=data_recorder, B=Slider(0.528, range=0.02..5))
sphere = Sphere(Base=PlaneXY(0, 0, 0), Radius=Slider(49, range=0..100))
sphere_2 = Sphere(Base=PlaneXY(0, 0, 0), Radius=Slider(19, range=0..100))  # disabled
populate_geometry = PopulateGeometry(Geometry=sphere, Count=100, Seed=1)
populate_geometry_2 = PopulateGeometry(Geometry=sphere_2, Count=100, Seed=1)
scale = Scale(Geometry=populate_geometry, Center=Point(0, 0, 0), Factor=multiplication)  # -> Geometry, Transform
line = Line(StartPoint=scale.Geometry, EndPoint=populate_geometry)
pipe = Pipe(Curve=line, Radius=Slider(0.16, range=0..1), Caps=0)
