# Grasshopper definition Pyarmid with grid.gh (Grasshopper 1.0.7)
# plug-ins: Bifocals

number_slider = Slider(11, range=0..100)
center_box = CenterBox(Base=PlaneXY(0, 0, 0), X=number_slider, Y=number_slider, Z=number_slider)

box_corners = BoxCorners(Box=center_box)  # -> CornerA, CornerB, CornerC, CornerD, CornerE, CornerF, CornerG, CornerH
_4point_surface = _4PointSurface(CornerA=box_corners.CornerE, CornerB=box_corners.CornerG, CornerC=box_corners.CornerB, CornerD=box_corners.CornerE)
extrude_point = ExtrudePoint(Base=_4point_surface, Point=box_corners.CornerF)

xz_plane = XZPlane(Origin=Point(0, 0, 0))

populate_3d = Populate3D(Region=center_box, Count=100, Seed=1)
sphere = Sphere(Base=populate_3d, Radius=Slider(2.5, range=0..100))
maelstrom = Maelstrom(Geometry=sphere, Plane=PlaneXY(0, 0, 0), First=0.1, Second=10, Angle=1.570796327, Rigid=False)
maelstrom_2 = Maelstrom(Geometry=maelstrom, Plane=xz_plane, First=0.1, Second=10, Angle=1.570796327, Rigid=False)

solid_difference = SolidDifference(BrepsA=center_box, BrepsB=maelstrom_2)
solid_difference_2 = SolidDifference(BrepsA=solid_difference, BrepsB=extrude_point)
