# Grasshopper definition Twisted.gh (Grasshopper 1.0.7)
# plug-ins: Bifocals

number_slider = Slider(10, range=0..10)
construct_point = ConstructPoint(XCoordinate=Slider(10, range=0..10), YCoordinate=Slider(0, range=0..10), ZCoordinate=Slider(10, range=0..10))
construct_point_2 = ConstructPoint(XCoordinate=Slider(0, range=0..10), YCoordinate=Slider(10, range=0..10), ZCoordinate=Slider(10, range=0..10))
construct_point_3 = ConstructPoint(XCoordinate=Slider(10, range=0..10), YCoordinate=Slider(10, range=0..10), ZCoordinate=Slider(0, range=0..10))
construct_point_4 = ConstructPoint(XCoordinate=Slider(0, range=0..10), YCoordinate=Slider(0, range=0..10), ZCoordinate=Slider(0, range=0..10))
_4point_surface = _4PointSurface(CornerA=construct_point_4, CornerB=construct_point_2, CornerC=construct_point, CornerD=construct_point_3)
kaleidoscope = Kaleidoscope(Geometry=_4point_surface, Plane=PlaneXY(0, 0, 0), Segments=Slider(6, range=0..100))  # -> Geometry, Transform
unit_z = UnitZ(Factor=Slider(10, range=0..10))
maelstrom = Maelstrom(Geometry=kaleidoscope.Geometry, Plane=PlaneXY(0, 0, 0), First=0.1, Second=10, Angle=1.570796327, Rigid=False)
linear_array = LinearArray(Geometry=maelstrom, Direction=unit_z, Count=Slider(5, range=0..10))  # -> Geometry, Transform
unit_z_2 = UnitZ(Factor=Slider(15, range=0..40))
mesh_shadow = MeshShadow(Mesh=linear_array.Geometry, Light=Vector(0, 0, -1), Plane=PlaneXY(0, 0, 0))
extrude = Extrude(Base=mesh_shadow, Direction=unit_z_2)
