# Grasshopper definition Walking Wall.gh (Grasshopper 1.0.7)
# plug-ins: Thomas Cyclically Symmetric System

gene_pool = GenePool(
    Decimals=6,
    Maximum=0.1,
    Minimum=0,
    Value=[0.05515824587, 0.06241795973, 0.07841151072, 0.04876894311, 0.02367960975, 0.08462766054, 0.07740671419, 0.01219096659, 0.0004116413185, 0.09537891182])
average = Average(Input=gene_pool)
thomas_cyclically_symmetric_system = ThomasCyclicallySymmetricSystem(B=Slider(0, range=0..1), Dt=average)
nurbs_curve = NurbsCurve(Vertices=thomas_cyclically_symmetric_system, Degree=3, Periodic=False)  # -> Curve, Length, Domain
divide_curve = DivideCurve(Curve=nurbs_curve.Curve, Count=Slider(100, range=0..100000), Kinks=False)  # -> Points, Tangents, Parameters
divide_curve_2 = DivideCurve(Curve=nurbs_curve.Curve, Count=Slider(100, range=0..100000), Kinks=False)  # -> Points, Tangents, Parameters
nurbs_curve_2 = NurbsCurve(Vertices=divide_curve.Points, Degree=3, Periodic=False)  # -> Curve, Length, Domain
nurbs_curve_3 = NurbsCurve(Vertices=divide_curve_2.Points, Degree=3, Periodic=False)  # -> Curve, Length, Domain
number_slider = Slider(15, range=0..100)
move = Move(Geometry=nurbs_curve_2.Curve, Motion=Vector(0, 0, 10))  # -> Geometry, Transform
unit_y = UnitY(Factor=1)
loft = Loft(
    Curves=[move.Geometry, nurbs_curve_3.Curve],
    Options={Adjust=False, Closed=False, LoftEnds=0, LoftSimp=0, LoftType=0, Rebuild=10, Refit=0.01})
extrude = Extrude(Base=loft, Direction=unit_y)
