# Grasshopper definition background.gh (Grasshopper 1.0.7)
# plug-ins: Bifocals

construct_point = ConstructPoint(
    XCoordinate=Slider(-16.44, range=-100..100),
    YCoordinate=Slider(-4.6, range=-100..100),
    ZCoordinate=Slider(0, range=-100..100))
construct_point_2 = ConstructPoint(
    XCoordinate=Slider(16.73, range=-100..100),
    YCoordinate=Slider(9.9, range=-100..100),
    ZCoordinate=Slider(0, range=-100..100))
construct_point_3 = ConstructPoint(
    XCoordinate=Slider(-20.16, range=-100..100),
    YCoordinate=Slider(30, range=-100..100),
    ZCoordinate=Slider(0, range=-100..100))
construct_point_4 = ConstructPoint(
    XCoordinate=Slider(7.99, range=-100..100),
    YCoordinate=Slider(-25.5, range=-100..100),
    ZCoordinate=Slider(30, range=-100..100))
construct_point_5 = ConstructPoint(
    XCoordinate=Slider(8.91, range=-100..100),
    YCoordinate=Slider(-0.69, range=-100..100),
    ZCoordinate=Slider(17.56, range=-100..100))
construct_point_6 = ConstructPoint(
    XCoordinate=Slider(-2.37, range=-100..100),
    YCoordinate=Slider(30, range=-100..100),
    ZCoordinate=Slider(30, range=-100..100))
construct_point_7 = ConstructPoint(
    XCoordinate=Slider(-12.92, range=-100..100),
    YCoordinate=Slider(-40, range=-100..100),
    ZCoordinate=Slider(0, range=-100..100))
construct_point_8 = ConstructPoint(
    XCoordinate=Slider(26.56, range=-100..100),
    YCoordinate=Slider(-9.54, range=-100..100),
    ZCoordinate=Slider(0, range=-100..100))
construct_point_9 = ConstructPoint(
    XCoordinate=Slider(7.03, range=-100..100),
    YCoordinate=Slider(30, range=-100..100),
    ZCoordinate=Slider(0, range=-100..100))
construct_point_10 = ConstructPoint(
    XCoordinate=Slider(30, range=-100..100),
    YCoordinate=Slider(-25.5, range=-100..100),
    ZCoordinate=Slider(30, range=-100..100))
construct_point_11 = ConstructPoint(
    XCoordinate=Slider(1.3, range=-100..100),
    YCoordinate=Slider(0.2, range=-100..100),
    ZCoordinate=Slider(17.56, range=-100..100))
construct_point_12 = ConstructPoint(
    XCoordinate=Slider(30, range=-100..100),
    YCoordinate=Slider(30, range=-100..100),
    ZCoordinate=Slider(30, range=-100..100))
construct_point_13 = ConstructPoint(
    XCoordinate=Slider(38.873, range=-100..100),
    YCoordinate=Slider(-50, range=-100..100),
    ZCoordinate=Slider(-3, range=-100..100))
construct_point_14 = ConstructPoint(
    XCoordinate=Slider(26.56, range=-100..100),
    YCoordinate=Slider(-9.54, range=-100..100),
    ZCoordinate=Slider(6, range=-100..100))
construct_point_15 = ConstructPoint(
    XCoordinate=Slider(61.595, range=-100..100),
    YCoordinate=Slider(30, range=-100..100),
    ZCoordinate=Slider(-8, range=-100..100))
construct_point_16 = ConstructPoint(
    XCoordinate=Slider(61.652, range=-100..100),
    YCoordinate=Slider(-25.5, range=-100..100),
    ZCoordinate=Slider(36, range=-100..100))
construct_point_17 = ConstructPoint(
    XCoordinate=Slider(81, range=-100..100),
    YCoordinate=Slider(0.2, range=-100..100),
    ZCoordinate=Slider(43.56, range=-100..100))
construct_point_18 = ConstructPoint(
    XCoordinate=Slider(46, range=-100..100),
    YCoordinate=Slider(24, range=-100..100),
    ZCoordinate=Slider(34.283, range=-100..100))
construct_point_19 = ConstructPoint(
    XCoordinate=Slider(16.873, range=-100..100),
    YCoordinate=Slider(-50, range=-100..100),
    ZCoordinate=Slider(-5, range=-100..100))
construct_point_20 = ConstructPoint(
    XCoordinate=Slider(26.56, range=-100..100),
    YCoordinate=Slider(-9.54, range=-100..100),
    ZCoordinate=Slider(0, range=-100..100))
construct_point_21 = ConstructPoint(
    XCoordinate=Slider(31.595, range=-100..100),
    YCoordinate=Slider(30, range=-100..100),
    ZCoordinate=Slider(0, range=-100..100))
construct_point_22 = ConstructPoint(
    XCoordinate=Slider(49.652, range=-100..100),
    YCoordinate=Slider(-25.5, range=-100..100),
    ZCoordinate=Slider(40, range=-100..100))
construct_point_23 = ConstructPoint(
    XCoordinate=Slider(3, range=-100..100),
    YCoordinate=Slider(0.2, range=-100..100),
    ZCoordinate=Slider(17.56, range=-100..100))
construct_point_24 = ConstructPoint(
    XCoordinate=Slider(30, range=-100..100),
    YCoordinate=Slider(30, range=-100..100),
    ZCoordinate=Slider(42.283, range=-100..100))
nurbs_curve = NurbsCurve(Vertices=[construct_point_7, construct_point_8, construct_point_9], Degree=2, Periodic=False)  # -> Curve, Length, Domain
nurbs_curve_2 = NurbsCurve(Vertices=[construct_point_10, construct_point_11, construct_point_12], Degree=2, Periodic=False)  # -> Curve, Length, Domain
nurbs_curve_3 = NurbsCurve(Vertices=[construct_point, construct_point_2, construct_point_3], Degree=2, Periodic=False)  # -> Curve, Length, Domain
nurbs_curve_4 = NurbsCurve(Vertices=[construct_point_4, construct_point_5, construct_point_6], Degree=2, Periodic=False)  # -> Curve, Length, Domain
nurbs_curve_5 = NurbsCurve(Vertices=[construct_point_13, construct_point_14, construct_point_15], Degree=2, Periodic=False)  # -> Curve, Length, Domain
nurbs_curve_6 = NurbsCurve(Vertices=[construct_point_16, construct_point_17, construct_point_18], Degree=2, Periodic=False)  # -> Curve, Length, Domain
nurbs_curve_7 = NurbsCurve(Vertices=[construct_point_19, construct_point_20, construct_point_21], Degree=2, Periodic=False)  # -> Curve, Length, Domain
nurbs_curve_8 = NurbsCurve(Vertices=[construct_point_22, construct_point_23, construct_point_24], Degree=2, Periodic=False)  # -> Curve, Length, Domain
number_slider = Slider(200, range=0..1000)
number_slider_2 = Slider(200, range=0..1000)
number_slider_3 = Slider(200, range=0..1000)
loft = Loft(
    Curves=[nurbs_curve_2.Curve, nurbs_curve.Curve],
    Options={Adjust=False, Closed=False, LoftEnds=0, LoftSimp=0, LoftType=0, Rebuild=10, Refit=0.01})
loft_2 = Loft(
    Curves=[nurbs_curve_6.Curve, nurbs_curve_5.Curve],
    Options={Adjust=False, Closed=False, LoftEnds=0, LoftSimp=0, LoftType=0, Rebuild=10, Refit=0.01})
loft_3 = Loft(
    Curves=[nurbs_curve_4.Curve, nurbs_curve_3.Curve],
    Options={Adjust=False, Closed=False, LoftEnds=0, LoftSimp=0, LoftType=0, Rebuild=10, Refit=0.01})
loft_4 = Loft(
    Curves=[nurbs_curve_8.Curve, nurbs_curve_7.Curve],
    Options={Adjust=False, Closed=False, LoftEnds=0, LoftSimp=0, LoftType=0, Rebuild=10, Refit=0.01})
populate_geometry = PopulateGeometry(Geometry=loft_3, Count=Slider(200, range=0..1000), Seed=1)
populate_geometry_2 = PopulateGeometry(Geometry=loft, Count=number_slider, Seed=number_slider)
populate_geometry_3 = PopulateGeometry(Geometry=loft_2, Count=number_slider_2, Seed=number_slider_2)
populate_geometry_4 = PopulateGeometry(Geometry=loft_4, Count=number_slider_3, Seed=number_slider_3)
gene_pool = GenePool(Decimals=2, Maximum=1, Minimum=0, Value=[0, 0.25, 0.5, 0.75, 1])
gene_pool_2 = GenePool(Decimals=2, Maximum=0.2, Minimum=0, Value=[0.1, 0.05, 0, 0.05, 0.1])
gene_pool_3 = GenePool(Decimals=2, Maximum=0.2, Minimum=0, Value=[0.1, 0.05, 0, 0.05, 0.1])
gene_pool_4 = GenePool(Decimals=2, Maximum=1, Minimum=0, Value=[0, 0.25, 0.5, 0.49, 1])
gene_pool_5 = GenePool(Decimals=2, Maximum=1, Minimum=0, Value=[0, 0.25, 0.5, 0.75, 1])
gene_pool_6 = GenePool(Decimals=2, Maximum=0.2, Minimum=0, Value=[0.1, 0.05, 0, 0.05, 0.1])
gene_pool_7 = GenePool(Decimals=2, Maximum=1, Minimum=0, Value=[0, 0.25, 0.5, 0.75, 1])
gene_pool_8 = GenePool(Decimals=2, Maximum=0.2, Minimum=0, Value=[0.1, 0.05, 0, 0.05, 0.1])
proximity_3d = Proximity3D(Points=populate_geometry_2, Group=5)  # -> Links, Topology
proximity_3d_2 = Proximity3D(Points=populate_geometry_3, Group=5)  # -> Links, Topology
proximity_3d_3 = Proximity3D(Points=populate_geometry, Group=5)  # -> Links, Topology
proximity_3d_4 = Proximity3D(Points=populate_geometry_4, Group=5)  # -> Links, Topology
colour_cmyk = ColourCMYK(Cyan=Slider(0.3, range=0..1), Magenta=Slider(1, range=0..1), Yellow=Slider(0, range=0..1), Key=Slider(0, range=0..1))
colour_cmyk_2 = ColourCMYK(Cyan=Slider(1, range=0..1), Magenta=Slider(0, range=0..1), Yellow=Slider(0.1, range=0..1), Key=Slider(0, range=0..1))
colour_cmyk_3 = ColourCMYK(Cyan=Slider(0, range=0..1), Magenta=Slider(0.2, range=0..1), Yellow=Slider(1, range=0..1), Key=Slider(0, range=0..1))
colour_cmyk_4 = ColourCMYK(Cyan=Slider(0.4, range=0..1), Magenta=Slider(0.2, range=0..1), Yellow=Slider(0.4, range=0..1), Key=Slider(0, range=0..1))
pipe_variable = PipeVariable(Curve=proximity_3d.Links, Parameters=gene_pool, Radii=gene_pool_2, Caps=0)
pipe_variable_2 = PipeVariable(Curve=proximity_3d_2.Links, Parameters=gene_pool_4, Radii=gene_pool_6, Caps=0)
pipe_variable_3 = PipeVariable(Curve=proximity_3d_4.Links, Parameters=gene_pool_7, Radii=gene_pool_8, Caps=0)
pipe_variable_4 = PipeVariable(Curve=proximity_3d_3.Links, Parameters=gene_pool_5, Radii=gene_pool_3, Caps=0)
create_material = CreateMaterial(Diffuse=colour_cmyk_2, Specular=RGB(255, 255, 255), Emission=RGB(0, 0, 0), Transparency=0, Shine=0)
create_material_2 = CreateMaterial(Diffuse=colour_cmyk_3, Specular=RGB(255, 255, 255), Emission=RGB(0, 0, 0), Transparency=0, Shine=0)
create_material_3 = CreateMaterial(Diffuse=colour_cmyk_4, Specular=RGB(255, 255, 255), Emission=RGB(0, 0, 0), Transparency=0, Shine=0)
create_material_4 = CreateMaterial(Diffuse=colour_cmyk, Specular=RGB(255, 255, 255), Emission=RGB(0, 0, 0), Transparency=0, Shine=0)
custom_preview = CustomPreview(Geometry=pipe_variable, Material=create_material)
custom_preview_2 = CustomPreview(Geometry=pipe_variable_2, Material=create_material_2)
custom_preview_3 = CustomPreview(Geometry=pipe_variable_4, Material=create_material_4)
custom_preview_4 = CustomPreview(Geometry=pipe_variable_3, Material=create_material_3)
