# Grasshopper definition lornenz with grid.gh (Grasshopper 1.0.7)
# plug-ins: Lorenz System, Bifocals

lorenz_system = LorenzSystem()
nurbs_curve = NurbsCurve(Vertices=lorenz_system, Degree=3, Periodic=False)  # -> Curve, Length, Domain
divide_curve = DivideCurve(Curve=nurbs_curve.Curve, Count=Slider(2700, range=0..10000), Kinks=False)  # -> Points, Tangents, Parameters
voronoi = Voronoi(Points=divide_curve.Points, BruteForceOverride=False)
