# Grasshopper definition lornenz.gh (Grasshopper 1.0.7)
# plug-ins: Lorenz System, Bifocals, Xing-Yun System

number_slider = Slider(11, range=0..100)
xing_yun_system = XingYunSystem()  # disabled
lorenz_system = LorenzSystem(Pr=Slider(7.73, range=1..100), Ra=Slider(20.6157, range=14.06..46))
center_box = CenterBox(Base=PlaneXY(0, 0, 0), X=number_slider, Y=number_slider, Z=number_slider)

populate_3d = Populate3D(Region=center_box, Count=100, Seed=1)
sphere = Sphere(Base=populate_3d, Radius=Slider(2.5, range=0..100))
maelstrom = Maelstrom(Geometry=sphere, Plane=PlaneXY(0, 0, 0), First=0.1, Second=10, Angle=1.570796327, Rigid=False)  # disabled
xz_plane = XZPlane(Origin=Point(0, 0, 0))
maelstrom_2 = Maelstrom(Geometry=maelstrom, Plane=xz_plane, First=0.1, Second=10, Angle=1.570796327, Rigid=False)
solid_difference = SolidDifference(BrepsA=center_box, BrepsB=maelstrom_2)

nurbs_curve = NurbsCurve(Vertices=xing_yun_system, Degree=3, Periodic=False)  # -> Curve, Length, Domain

box_corners = BoxCorners(Box=center_box)  # -> CornerA, CornerB, CornerC, CornerD, CornerE, CornerF, CornerG, CornerH
_4point_surface = _4PointSurface(CornerA=box_corners.CornerE, CornerB=box_corners.CornerG, CornerC=box_corners.CornerB, CornerD=box_corners.CornerE)
extrude_point = ExtrudePoint(Base=_4point_surface, Point=box_corners.CornerF)

pipe = Pipe(Curve=nurbs_curve.Curve, Radius=Slider(0.5, range=0..1), Caps=Slider(2, range=0..10))
solid_difference_2 = SolidDifference(BrepsA=center_box, BrepsB=pipe)
solid_difference_3 = SolidDifference(BrepsA=solid_difference, BrepsB=extrude_point)
