# Grasshopper definition mesh lump.gh (Grasshopper 1.0.7)
# plug-ins: Bifocals

number_slider = Slider(20, range=0..100)
number_slider_2 = Slider(-20, range=-20..100)
domain_box = DomainBox(Base=PlaneXY(0, 0, 0), X=number_slider, Y=number_slider, Z=number_slider)
domain_box_2 = DomainBox(Base=PlaneXY(0, 0, 0), X=number_slider, Y=number_slider_2, Z=number_slider)
domain_box_3 = DomainBox(Base=PlaneXY(0, 0, 0), X=number_slider_2, Y=number_slider_2, Z=number_slider)
domain_box_4 = DomainBox(Base=PlaneXY(0, 0, 0), X=number_slider_2, Y=number_slider, Z=number_slider)
populate_3d = Populate3D(Region=domain_box, Count=Slider(4, range=0..10), Seed=Slider(32, range=0..100))
populate_3d_2 = Populate3D(Region=domain_box_2, Count=Slider(4, range=0..10), Seed=Slider(35, range=0..100))
populate_3d_3 = Populate3D(Region=domain_box_3, Count=Slider(4, range=0..10), Seed=Slider(53, range=0..100))
populate_3d_4 = Populate3D(Region=domain_box_4, Count=Slider(4, range=0..10), Seed=Slider(70, range=0..100))
nurbs_curve = NurbsCurve(Vertices=populate_3d, Degree=3, Periodic=False)  # -> Curve, Length, Domain
nurbs_curve_2 = NurbsCurve(Vertices=populate_3d_2, Degree=3, Periodic=False)  # -> Curve, Length, Domain
nurbs_curve_3 = NurbsCurve(Vertices=populate_3d_3, Degree=3, Periodic=False)  # -> Curve, Length, Domain
nurbs_curve_4 = NurbsCurve(Vertices=populate_3d_4, Degree=3, Periodic=False)  # -> Curve, Length, Domain
edge_surface = EdgeSurface(CurveA=nurbs_curve.Curve, CurveB=nurbs_curve_2.Curve, CurveC=nurbs_curve_3.Curve, CurveD=nurbs_curve_4.Curve)
vector_xyz = VectorXYZ(XComponent=Slider(2, range=0..100), YComponent=Slider(3, range=0..100), ZComponent=Slider(8, range=0..100))  # -> Vector, Length
extrude = Extrude(Base=edge_surface, Direction=vector_xyz.Vector)
populate_geometry = PopulateGeometry(Geometry=extrude, Count=Slider(300, range=0..1100), Seed=1)
proximity_3d = Proximity3D(Points=populate_geometry, Group=5)  # -> graft(Links), Topology
pipe_variable = PipeVariable(
    Curve=proximity_3d.Links,
    Parameters=[Slider(0, range=0..1), Slider(0.5, range=0..1), Slider(1, range=0..1)],
    Radii=[Slider(0.12, range=0..1), Slider(0.02, range=0..1), Slider(0.12, range=0..1)],
    Caps=2)
