# Grasshopper definition ribbion_1.gh (Grasshopper 1.0.7)
# plug-ins: Bifocals, Thomas Cyclically Symmetric System

thomas_cyclically_symmetric_system = ThomasCyclicallySymmetricSystem(B=Slider(0, range=0..61))
nurbs_curve = NurbsCurve(Vertices=thomas_cyclically_symmetric_system, Degree=3, Periodic=False)  # -> Curve, Length, Domain
divide_curve = DivideCurve(Curve=nurbs_curve.Curve, Count=Slider(233, range=0..1100), Kinks=False)  # -> Points, Tangents, Parameters
divide_curve_2 = DivideCurve(Curve=nurbs_curve.Curve, Count=Slider(101, range=0..1100), Kinks=False)  # -> Points, Tangents, Parameters
nurbs_curve_2 = NurbsCurve(Vertices=divide_curve.Points, Degree=3, Periodic=False)  # -> Curve, Length, Domain
nurbs_curve_3 = NurbsCurve(Vertices=divide_curve_2.Points, Degree=3, Periodic=False)  # -> Curve, Length, Domain
loft = Loft(
    Curves=[nurbs_curve_3.Curve, nurbs_curve_2.Curve],
    Options={Adjust=False, Closed=False, LoftEnds=0, LoftSimp=0, LoftType=0, Rebuild=10, Refit=0.01})
pipe_variable = PipeVariable(Caps=0)
pipe = Pipe(Curve=[nurbs_curve_2.Curve, nurbs_curve_3.Curve], Radius=Slider(0.37, range=0..1), Caps=0)
brep_join = BrepJoin(Breps=[pipe, loft])  # -> Breps, Closed
