# Grasshopper definition ribbion_2.gh (Grasshopper 1.0.7)
# plug-ins: Bifocals, Thomas Cyclically Symmetric System

thomas_cyclically_symmetric_system = ThomasCyclicallySymmetricSystem(B=Slider(0, range=0..61))
nurbs_curve = NurbsCurve(Vertices=thomas_cyclically_symmetric_system, Degree=3, Periodic=False)  # -> Curve, Length, Domain
divide_curve = DivideCurve(Curve=nurbs_curve.Curve, Count=Slider(37, range=0..1100), Kinks=False)  # -> Points, Tangents, Parameters
divide_curve_2 = DivideCurve(Curve=nurbs_curve.Curve, Count=Slider(233, range=0..1100), Kinks=False)  # -> Points, Tangents, Parameters
nurbs_curve_2 = NurbsCurve(Vertices=divide_curve.Points, Degree=3, Periodic=False)  # -> Curve, Length, Domain
nurbs_curve_3 = NurbsCurve(Vertices=divide_curve_2.Points, Degree=3, Periodic=False)  # -> Curve, Length, Domain
loft_options = LoftOptions(Closed=False, Adjust=False, Rebuild=0, Refit=Slider(0.13, range=0..1), Type=Slider(5, range=0..5))
loft = Loft(Curves=[nurbs_curve_2.Curve, nurbs_curve_3.Curve], Options=loft_options)
pipe_variable = PipeVariable(
    Curve=reparameterize([nurbs_curve_2.Curve, nurbs_curve_3.Curve]),
    Parameters=[Slider(1, range=0..1), Slider(0, range=0..1), Slider(0.06, range=0..1), Slider(0.31, range=0..1), Slider(0.64, range=0..1), Slider(0.82, range=0..1)],
    Radii=[Slider(0, range=0..1), Slider(0.06, range=0..1), Slider(0.94, range=0..3), Slider(0.8, range=0..1), Slider(0.46, range=0..1), Slider(0.1, range=0..1)],
    Caps=0)
brep_join = BrepJoin(Breps=[loft, pipe_variable])  # -> Breps, Closed
